# Grasshopper definition Revit_Dagslys script_V1_rac basic sample project.gh (Grasshopper 1.0.7)
# plug-ins: MetaHopper, LadybugGrasshopper, Rhino.Inside for Autodesk Revit, ClipperComponents, Human, LunchBox, MeshEdit Components, HDTTreeUtils

# ----
# Bake til Rhino layers
toggle = BooleanToggle(True)
layer_info = LayerInformation(ReferenceToggle=toggle)  # -> Names, DisplayColors, GUID
panel = Panel(layer_info.Names)
button = Button()
createatts = CreateAttributes(LayerName="Columns", enableFullPath=False)
createatts_2 = CreateAttributes(LayerName="Floors", enableFullPath=False)
createatts_3 = CreateAttributes(LayerName="Roofs & Ceilings", enableFullPath=False)
createatts_4 = CreateAttributes(LayerName="Interior", enableFullPath=False)
createatts_5 = CreateAttributes(LayerName="Exterior", enableFullPath=False)
createatts_6 = CreateAttributes(LayerName="W Glass", enableFullPath=False)
createatts_7 = CreateAttributes(LayerName="W Frame", enableFullPath=False)
createatts_8 = CreateAttributes(LayerName="D Glass", enableFullPath=False)
createatts_9 = CreateAttributes(LayerName="D Doors", enableFullPath=False)
createatts_10 = CreateAttributes(LayerName="Terrain", enableFullPath=False)
bake = BakeObject(ObjectAttributes=createatts_2, Bake=button, AllObjects_Object=geometry_3)
bake_2 = BakeObject(ObjectAttributes=createatts_4, Bake=button, AllObjects_Object=interior_face_walls)
bake_3 = BakeObject(ObjectAttributes=createatts_3, Bake=button, AllObjects_Object=[geometry_4, geometry_2])
bake_4 = BakeObject(ObjectAttributes=createatts_6, Bake=button, AllObjects_Object=[glas_3, windows_glass_5])
bake_5 = BakeObject(ObjectAttributes=createatts_5, Bake=button, AllObjects_Object=exterior_wall_face)
bake_6 = BakeObject(ObjectAttributes=createatts, Bake=button, AllObjects_Object=geometry_5)
bake_7 = BakeObject(ObjectAttributes=createatts_7, Bake=button, AllObjects_Object=[geometry_6, frame_mullion_3])
bake_8 = BakeObject(ObjectAttributes=createatts_10, Bake=button, AllObjects_Object=geometry)
bake_9 = BakeObject(ObjectAttributes=createatts_8, Bake=button, AllObjects_Object=door_glass)
bake_10 = BakeObject(ObjectAttributes=createatts_9, Bake=button, AllObjects_Object=[doors_panel, doors_frame_mullion])

# ----
# Der er igennem scriptet placeret hvide 'Panels'. Disse
# indeholder kort overordnede forklaringer af udvalgte
# komponenter, samt flow. Disse er udelukkende tænkt som
# hjælp til forståelsen af nedenstående script og/eller, din,
# mulighed for at justere og forbedre scriptet.
overskrift = Panel("INDHOLD")

# ----
# Opsætning af analysemodel
indhent_fra_mappe = GhPythonScript()  # -> out, a
# ---------- indhent_fra_mappe: Python ----------
__author__ = "lhf"
__version__ = "2024.02.05"

import os

# Get the Grasshopper file path
gh_file_path = ghenv.Component.OnPingDocument().FilePath

# Check if the Grasshopper file is saved
if gh_file_path:
    # Get the directory name (folder) of the Grasshopper file
    gh_folder = os.path.dirname(gh_file_path)
    
    # Define the subfolder name
    subfolder_name = "04 Simuleringsresultat - Data"
    
    # Create the path to the subfolder
    subfolder_path = os.path.join(gh_folder, subfolder_name)
    
    # Check if the subfolder exists
    if os.path.exists(subfolder_path):
        print("The Grasshopper file is located in the folder: {}".format(gh_folder))
        print("Going into the subfolder: {}".format(subfolder_name))
        a = subfolder_path
    else:
        print("The subfolder '{}' does not exist in the Grasshopper file folder.".format(subfolder_name))
        a = None
else:
    print("Save the Grasshopper file before running this script.")
    a = None
# ---------- end indhent_fra_mappe ----------
indhent_fra_mappe_2 = GhPythonScript()  # -> out, a
# ---------- indhent_fra_mappe_2: Python ----------
__author__ = "lhf"
__version__ = "2024.02.05"

import os

# Get the Grasshopper file path
gh_file_path = ghenv.Component.OnPingDocument().FilePath

# Check if the Grasshopper file is saved
if gh_file_path:
    # Get the directory name (folder) of the Grasshopper file
    gh_folder = os.path.dirname(gh_file_path)
    
    # Define the subfolder name
    subfolder_name = "02 Grund Data"
    
    # Define the specific file name
    file_name = "DRY_2001-2010_epw-fil.epw"
    
    # Create the path to the subfolder
    subfolder_path = os.path.join(gh_folder, subfolder_name)
    
    # Create the full path to the specific file
    specific_file_path = os.path.join(subfolder_path, file_name)
    
    # Check if the file exists
    if os.path.exists(specific_file_path):
        print("The Grasshopper file is located in the folder: {}".format(gh_folder))
        print("Going into the subfolder: {}".format(subfolder_name))
        print("Choosing the specific file: {}".format(file_name))
        a = specific_file_path
    else:
        print("The specific file '{}' does not exist in the 'Grund Data' folder.".format(file_name))
        a = None
else:
    print("Save the Grasshopper file before running this script.")
    a = None
# ---------- end indhent_fra_mappe_2 ----------
indhent_fra_mappe_3 = GhPythonScript()  # -> out, a
# ---------- indhent_fra_mappe_3: Python ----------
__author__ = "lhf"
__version__ = "2024.02.05"

import os

# Get the Grasshopper file path
gh_file_path = ghenv.Component.OnPingDocument().FilePath

# Check if the Grasshopper file is saved
if gh_file_path:
    # Get the directory name (folder) of the Grasshopper file
    gh_folder = os.path.dirname(gh_file_path)
    
    # Define the subfolder name
    subfolder_name = "02 Grund Data"
    
    # Define the specific file name
    file_name = "StandardBR18_SunlitHours_Sun_is_up.csv"
    
    # Create the path to the subfolder
    subfolder_path = os.path.join(gh_folder, subfolder_name)
    
    # Create the full path to the specific file
    specific_file_path = os.path.join(subfolder_path, file_name)
    
    # Check if the file exists
    if os.path.exists(specific_file_path):
        print("The Grasshopper file is located in the folder: {}".format(gh_folder))
        print("Going into the subfolder: {}".format(subfolder_name))
        print("Choosing the specific file: {}".format(file_name))
        a = specific_file_path
    else:
        print("The specific file '{}' does not exist in the 'Grund Data' folder.".format(file_name))
        a = None
else:
    print("Save the Grasshopper file before running this script.")
    a = None
# ---------- end indhent_fra_mappe_3 ----------
indsæt_sti_til_projektmappens_analyseres = Panel(indhent_fra_mappe.a)  # "Indsæt sti til projektmappens analyseresultat"
sti_til_epw_filen_vejrfil = Panel(indhent_fra_mappe_2.a)
sti_til_antal_soltimer_jvf_br18_standard = Panel(indhent_fra_mappe_3.a)

# ----
# 1.
# Navn og resultat mappe
# Navngiv projektet i tekstboksen
definer_projektets_navn = Panel("Dagslys Script")

toggle_2 = BooleanToggle(True)
toggle_3 = BooleanToggle(False)
toggle_4 = BooleanToggle(False)
toggle_5 = BooleanToggle(False)
toggle_6 = BooleanToggle(True)
cluster = Cluster(E=toggle_2, T=toggle_2)
cluster_2 = Cluster_2(E=toggle_6, T=toggle_6)
cluster_3 = Cluster_3(E=toggle_3, T=toggle_3)
cluster_4 = Cluster_4(E=toggle_4, T=toggle_4)
cluster_5 = Cluster_5(T=toggle_5, V=toggle_5, E=toggle_5)
panel_2 = Panel(cluster_3)
panel_3 = Panel(cluster)
panel_4 = Panel(cluster_2)
panel_5 = Panel(cluster_4)
panel_6 = Panel(cluster_5)

# ----
# 3.
# Indstil nord-retning
# Hvis modellen ikke ligger rigtigt i forhold til nord, kan
# man her rotere modellen efter en korrekt placering
# af solen. Rotationen sker mod urets retning.
# 
# Roter nordpiplen ved at justeres på nedenstående
# 'Number slider'. Derudover kan nordpilen tændes
# og slukkes på nedenstående 'Value list' ved at trykke
# på komponentets pile.
# INDSTILLING AF NORD (Rotation mod uretsretning): 0 grader = Nord
# 90 grader = Vest
# 180 grader = Syd
# 270 grader = Øst
number_slider = Slider(0, range=0..360)
list = ValueList({"Vis nordpil": True, "Vis ikke nordpil": False}, selected="Vis nordpil")
onoff = EnableDisableObject(Enabled=list, AllObjects_Object=[circle, vdisex_5, tag])

# ----
# 5.
# Definer type af simulering
# Dernæst skal der defineres om analysen udføres i hensigt
# til DGNB Eller BR18 (Det har betydning for analysens
# 'Grid size' der definerer hvor detaljeret analysen udføres.
# På nedenståene 'Dropdown' liste vælges der hvilken type
# dagslysanalyse der skal udføres. Her skal man vælge
# imellem en fuldbygnignsanalyse, eller en analyse på de
# specifikke rum i revitmodellen.
# 
# OBS. Der kan kun vælges rum der er et tilknyttet room tag
# i revit.
list_2 = ValueList({"BR18": 700, "DGNB": 250, "Custom": 100}, selected="DGNB")
list_3 = ValueList({"Fuld bygningsanalyse": True, "Udvælgelse af specifikke rum": False}, selected="Udvælgelse af specifikke rum")
not = GateNot(A=list_3)
onoff_2 = EnableDisableObject(Enabled=not, AllObjects_Object=[rooms_5, rooms_4, resterende_rum, mindex_11, rooms_6, panel_12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])
onoff_3 = EnableDisableObject(Enabled=list_3, AllObjects_Object=[list_4, levels_analyseflade, full_level])

# ---- group: Fuld bygningsanalyse
# FULD BYGNINGSANALYSE
# 2.1 - HØJDE AF ANALYSEFLADE
# Dette har betydning for analysefaldens højde. I en
# bolig analyseres overfladen i 500 mm. over gulvflade
# og i arbejdsrum analyseres i 850 mm. over gulvfalden.
# 2.2 - VALG AF ETAGE / ETAGER
# For nemmere at trække en billede ud af modellen
# rådes det til at, ved fuld bygnignsanalyser, kun at
# haveaktiveret det level man analyserer i, da 'Heat
# maps' ellers vil ligge oven i hinanden, og billedet
# vil fremstå rodet
# 
# Hvis ovenstående ikke er gældende i din model, så
# skal alle levels være aktiveret, og du får derved et
# visuelt syn på ALLE dine analysefalder
# 
# OBS! Analyseflader er et produkt af revit 'Rooms'
# Det er derfor vigtigt at de rum du analysere er et
# Revit Room!
list_4 = ValueList({"Bolig - 500 mm.": 500, "Arbejdsrum 850 mm": 850}, selected="Bolig - 500 mm.")  # disabled
levels_analyseflade = LevelsPicker(<levels picker referenced from the Revit model>)  # disabled

# ---- group: Detaljeret rum analyse
# 2.3 - UDVÆLGELSE AF RUM
# Skriv det præcise rumnavn på de rum der skal medtages i analysen.
# Dette skal skrives i de røde bokse
# 
# OBS! Vigtig at skrive det præcis. Den er meget følsom og kan skelner
# f.eks. ikke mellem store og små bogstaver
rooms = QueryRooms(Placed=True)  # disabled
komplet_liste_af_rum_i_modellen = Panel(rooms)  # disabled

# ----
# Importer Geometri til 'Honeybee Faces': For hvert sæt af geometri hentet fra revit modellen, laves der en 'Honeybee Face'. Denne 'Face' bruges til at definere reflektionsværdien af de forskellige overflader. Reflektionsværdien er sat ud fra BR18's lysreflektans værdier.
# 
# Lysreflektans værdierne findes på nedenstående link under pkt. '1.2 Dagslys':
# https://bygningsreglementet.dk/Tekniske-bestemmelser/18/Vejledninger/Generel_vejledning/Dagslys
dgnb_reflektanser = ValueList({"DGNB_Ren hvid gips": 0.85, "DGNB_Hvis cementpuds": 0.75, "DGNB_Kalkpuds, lys,": 0.45, "DGNB_Puds, ny, hvidtet": 0.8, "DGNB_Puds, gammel, hvidtet": 0.5, "DGNB_Almindelie loft": 0.6, "DGNB_Cementpuds, beton, ren": 0.4, "DGNB_Cementpuds, beton, meget snavset": 0.05, "DGNB_Hvide fliser": 0.85, "DGNB_Hvid marmor": 0.65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}, selected="DGNB_Hvid marmor")

# ---- group: EVENTUEL KONTEKST OVERFALDER/BYGNINGER
pipeline = GeometryPipeline(
    GroupByLayer=False,
    GroupByType=False,
    IncludeHidden=True,
    IncludeLocked=True,
    LayerFilter="Kontekst - Buildings",
    NameFilter="*",
    SublayerFiltering=True,
    TypeFilter=1073741880)
opaquemod = HBOpaqueModifier(name="BR18_Omgivelser", reflect=Slider(0.2, range=0..1))  # -> modifier; plug-in component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
shade = HBShade(geo=pipeline, name="Context - Buildings", rad_mod=opaquemod)  # -> report, shades; plug-in component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

# ---- group: TJEK AF FORSKELLIGE MODIFICATIONS I MODELLEN
searchmods = HBSearchMofidiers()  # -> modifiers; plug-in component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
panel_7 = Panel(searchmods)

# ----
# 6.
# Udvælg LT-værdi på vinduer
# Vælg den type LT værdi der tilhører de specifikke ruder. Hvis ikke 'ekstra' LT værdi vælges bruges den samme LT-værdi på alle ruder
lt_rudetype_1 = Slider(0.7, range=0..1)

lt_1 = Number(lt_rudetype_1)

# ---- group: NORDPIL / JUSTERING AF NORDPIL
nord_tekst_afstand_til_pilens_spids = Slider(6000, range=0..10000)
teksten_over_pilen = Panel("NORD")
størrelse_på_nord_tekst = Slider(11, range=0..20)
tykkelse_på_pilen = Slider(5, range=0..10)
længde_på_pilen = Slider(26, range=0..100)

# ----
# 7.
# Påbegynd simulering
# Tryk nedenstående start knap til 'True' for at starte
# simuleringen for at sætte en ny simulering igang
# trykkes nedenstående knap tilbage på 'False' og
# dernæst 'True'. Vær opmærksom på, at alt
# afhængelig af projektet kan analysen tage noget
# tid og tage MEGET computerkraft!
start_dagslyssimulering = LBFalseStartToggle(False)

# ---- group: Lux indstilling til heatmap
# På nedenstående 'Value list' kan analyse 'treshold'
# vælges. Dette har betydning for ovenstående.
# sDA beregning og det visuelle 'Heatmap'
list_5 = ValueList({"100 lux": 100, "200 lux": 200, "300 lux": 300, "500 lux": 500}, selected="300 lux")

# ---- group: Visning af skala
tænd_sluk_for_skala = BooleanToggle(False)
vis_skala = HideShowObjectPreview(Visible=tænd_sluk_for_skala, AllObjects_Object=legend)

# ---- group: Visning af glas / Apertures
tænd_sluk = BooleanToggle(False)
vis_ramme_panel = HideShowObjectPreview(Visible=tænd_sluk, AllObjects_Object=[rammer_sprosser, door_panel])
tænd_sluk_2 = BooleanToggle(False)
vis_glas = HideShowObjectPreview(Visible=tænd_sluk_2, AllObjects_Object=[clean_4, door_glass_2, clean_2, clean_3])

# ---- group: TIMEBASERET ÅRLIG DAGSLYSBEREGNING / RADIANCE PARAMETER
# 'HB RADAIANCE PARAMETER': _Detail_level_ kan her ændres til at lave en mere detaljeret analyse. Vær forsigtig med dette, da det opjusteret analysetiden markant herefter.
# 
# https://www.ladybug.tools/radiance/image-parameters
dgnb_radiance_parameters = Panel("-aa 0.1 -ab 5 -ad 5000 -ar 256")
list_6 = ValueList({"Dagslysfaktor": 0, "Årlig analyse / Lux": 2}, selected="Årlig analyse / Lux")
list_7 = ValueList({"Lav kvalitet": 0, "Mellem kvalitet": 1, "Høj kvalitet": 2}, selected="Høj kvalitet")
radpar = HBRadianceParameter(recipe_type=list_6, detail_level=list_7, additional_par=dgnb_radiance_parameters)  # -> rad_par; plug-in component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

# ---- group: Radiance parametre
# ab - Ambient Bounces
# ad - Ambient Divisions
# as - Ambient Super-samples
# c - Color format
# dc - Direct Certainty
# dp - Direct-pretest density
# dr - Direct relays
# ds - Source substructturing
# dt - Direct treshold
# lr - Limit reflection
# lw - Limit weight
# ss - Specular sampling
# st - Specular threshold
# 
# https://www.manula.com/manuals/zrogers/spot-pro-v-5/1/en/topic/radiance-parameters
radiance_parameter = Data(radpar)
radiance_input_parameter = Panel(radiance_parameter)

# ---- group: TIMEBASERET ÅRLIG DAGSLYSBEREGNING / DATAHÅNDTERING
# 'HB RECIPE SETTINGS': Dette komponent bruges til flere forskellige ting:
# 
# 1) _Folder_: Her defineres om og hvor man vil gemme sine dagslysresultater. Disse resultater kan bruges til at loade ind i modellen igen, hvis man ikke vil køre analysen igen.
# 
# 2) _Workers_: Definere hvor mange CPU'er man vil bruge. Dette betyder hvor hårdt (og hurtigt) analysen skal køres. Som udgangspunkt, hvis du vil bruge din pc samtidig, skal du IKKE brugge alle dine CPU'er. Hvis alle CPU'er bruges stort set alt din computerkraft til simuleringen.
# 
# 3) Reload_old_: Ved at sætte denne 'Boolean toggle' til 'True' genbruger du den data der allerede er lavet på den sti der er defineret under '_Folder_'.
number_slider_2 = Slider(4, range=1..20)
path = FilePath(indsæt_sti_til_projektmappens_analyseres)
recipesettings = HBRecipeSettings(folder=path, workers=number_slider_2, reload_old=Toggle(False))  # -> settings; plug-in component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

# ---- group: TIMEBASERET ÅRLIG DAGSLYSBEREGNING / VEJRFIL
# DAGSLYS SIMULERING
path_2 = FilePath(sti_til_epw_filen_vejrfil)
wea = HBWeaFromEPW(epw_file=path_2)  # -> wea; plug-in component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

# ---- group: BEREGNING AF SPATIAL DAYLIGHT AUTONOMY (sDA) / DEFINER OM ANALYSEN ER NY ELLER DER ER EKSITERENDE DATA
daylight_lookup = GhPythonScript(path=path)  # -> daylight_folder
# ---------- daylight_lookup: Python ----------
__author__ = "kongs"
__version__ = "2022.06.04"

import os

if path:
    daylight_folder = os.path.join(path, "annual_daylight", "results")
# ---------- end daylight_lookup ----------
list_8 = ValueList({"Eksisterende Analyse": False, "Ny analyse": True}, selected="Ny analyse")
not_2 = GateNot(A=list_8)
onoff_4 = EnableDisableObject(Enabled=not_2)
onoff_5 = EnableDisableObject(Enabled=list_8)

# ---- group: EFTERVISNING AF RESULTAT / DEFINERER HVAD ENS 'LEGEND' SKAL VISE
# RESULTAT: Resultat delen af scriptet består af 3 dele:
# 
# 1) Legend/Skala: Her kan legend'en justeres til at indeholde en ønsket skala samt farve på analysen osv.
# 
# 2) Heatmap: Er den visuelle repræsemtation af analysen.
# 
# 3) Procenttekst: angiver hvor amnge procent af analyseoverfladen der opfylder kravet over treshold.
antal_decimaler = Slider(1, range=0..1)
# DAGSLYS RESULTAT & VISUALISERING
number_slider_3 = Slider(50, range=0..100)
colrange = LBColorRange(index=Slider(0, range=0..25))  # -> colors; plug-in component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
legendpar = LBLegendParameters(min=number_slider_3, max=Slider(100, range=0..100), colors=colrange, num_decimals=antal_decimaler)  # -> leg_par; plug-in component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

# ----
# IMPORTERING AF REVIT GEOMETRI
antal_elementer_der_tælles_med_i_query_e = Panel("10000000")  # "Antal elementer der tælles med i 'Query Elements'-componentet"
rooms_2 = QueryRooms(Placed=True, Level=levels_analyseflade, Enclosed=True)

# ----
# Terræn
categories = BuiltInCategories("autodesk.revit.category.local:topography-1.0.0", SearchPattern="Topography")
catfltr = CategoryFilter(Categories=categories, Inverted=False)
elements = QueryElements(Filter=catfltr, Limit=antal_elementer_der_tælles_med_i_query_e)  # -> Elements, Count
geometry = ElementGeometry(Elements=elements.Elements)  # -> Geometry, Categories

# ----
# Udvælgelse af etageoverflade
# Analyseflade
# Udvælgelse af specifikke gulvoverflader
debrep = DeconstructBrep(Brep=rooms_2)  # -> Faces, Edges, Vertices
udvælgelse_af_nederste_face = UdvælgelseAfNedersteFace(S=debrep.Faces)
item = ListItem(List=debrep.Faces, Index=udvælgelse_af_nederste_face, Wrap=True)

# ---- group: TERRÆN
rhino_terrain = GeometryPipeline(
    GroupByLayer=False,
    GroupByType=False,
    IncludeHidden=True,
    IncludeLocked=True,
    LayerFilter="Kontekst - Terrain",
    NameFilter="*",
    SublayerFiltering=True,
    TypeFilter=1073741880)  # disabled
opaquemod_2 = HBOpaqueModifier(name="BR18_Omgivelser_Natur", reflect=Slider(0.1, range=0..1))  # -> modifier; plug-in component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
terrain = Geometry(geometry.Geometry)  # disabled
shade_2 = HBShade(geo=[rhino_terrain, terrain], name="Context - Terrain", rad_mod=opaquemod_2)  # -> report, shades; plug-in component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

# ----
# 2.
# Udvælgelse af Geometri
# 3.1 Geometri
# Vælg hvilke etager i modellen der skal
# medbringes i beregningerne.
# 
# OBS! Jeg vil råde til at medtage det hele, da der er
# risiko for at fjerne evt. skyggende geometri, der har
# relevans for dagslysanalysen.
levels = LevelsPicker([<levels picker referenced from the Revit model> x6])

selected_levels = Data(levels)
levelfltr = LevelFilter(Levels=selected_levels, Inverted=False)

# ----
# Væg
# Vægge
categories_2 = BuiltInCategories("autodesk.revit.category.local:walls-1.0.0", SearchPattern="walls")
catfltr_2 = CategoryFilter(Categories=categories_2, Inverted=False)
andfltr = LogicalAndFilter(FilterA=levelfltr, FilterB=catfltr_2)
elements_2 = QueryElements(Filter=andfltr, Limit=antal_elementer_der_tælles_med_i_query_e)  # -> Elements, Count

# ----
# 4.
# Udvælg vægge i glas
# Vælg den/de væg typer hvor væggen er glas. Hvis ingen glasvægge
# i modellen vælg ikke en kategori her.
# 
# OBS! Curtain walls er IKKE inkluderet i dette. Denne faktor er KUN
# for skitsevægge for curtain walls ikke er brugt, men i stedet et 'wall element'
wall_category = Data(categories_2)
element_type_picker = ElementTypePicker(
    wall_category,
    {"Basic Wall : CL_W1": "e340d1fc-19c1-4200-9ff0-415bc126641d:e9d71ae9-50a0-4fd0-b533-dbc08decd09f-00092a3a", "Basic Wall : Cavity wall_sliders": "e340d1fc-19c1-4200-9ff0-415bc126641d:f565bef9-7d27-4781-b8d4-60f4a6034d87-000ce6a8", "Basic Wall : Exterior - Block on Mtl. Stud": "e340d1fc-19c1-4200-9ff0-415bc126641d:4d24d0d6-38f1-47b8-a376-b40c6432dad5-0000d50a", "Basic Wall : Exterior - Brick on Mtl. Stud": "e340d1fc-19c1-4200-9ff0-415bc126641d:e3e052f9-0156-11d5-9301-0000863f27ad-0000018d", "Basic Wall : Foundation - 300mm Concrete": "e340d1fc-19c1-4200-9ff0-415bc126641d:7f28cee1-b998-4a37-89e2-f58405cbbc56-0008df7c", "Basic Wall : Interior - 165 Partition (1-hr)": "e340d1fc-19c1-4200-9ff0-415bc126641d:88b03b05-80d3-484f-8022-471f61604c8d-00038d32", "Basic Wall : Interior - Partition": "e340d1fc-19c1-4200-9ff0-415bc126641d:88b03b05-80d3-484f-8022-471f61604c8d-00038d7b", "Basic Wall : Retaining - 300mm Concrete": "e340d1fc-19c1-4200-9ff0-415bc126641d:1551350c-45e5-41b8-bdf1-bcfa6794dc6a-000adce2", "Basic Wall : SIP 202mm Wall - conc clad": "e340d1fc-19c1-4200-9ff0-415bc126641d:c85e5be0-d8d5-4148-836f-b55e711ef373-00068b9b", "Basic Wall : Wall - Timber Clad": "e340d1fc-19c1-4200-9ff0-415bc126641d:ef57b02a-5e81-49e7-93bb-ae5f002d921c-000306df", "Curtain Wall : SH_Curtain wall": "e340d1fc-19c1-4200-9ff0-415bc126641d:6cbabf1d-e8d0-47f0-ac4d-9a7923128d37-000700af"}, selected=[])

# ----
# Lofte
categories_3 = BuiltInCategories("autodesk.revit.category.local:ceilings-1.0.0", SearchPattern="ceilings")
catfltr_3 = CategoryFilter(Categories=categories_3, Inverted=False)
andfltr_2 = LogicalAndFilter(FilterA=levelfltr, FilterB=catfltr_3)
elements_3 = QueryElements(Filter=andfltr_2, Limit=antal_elementer_der_tælles_med_i_query_e)  # -> Elements, Count
geometry_2 = ElementGeometry(Elements=elements_3.Elements)

# ----
# Gulve
categories_4 = BuiltInCategories("autodesk.revit.category.local:floors-1.0.0", SearchPattern="Floors")
catfltr_4 = CategoryFilter(Categories=categories_4, Inverted=False)
andfltr_3 = LogicalAndFilter(FilterA=levelfltr, FilterB=catfltr_4)
elements_4 = QueryElements(Filter=andfltr_3, Limit=antal_elementer_der_tælles_med_i_query_e)  # -> Elements, Count
geometry_3 = ElementGeometry(Elements=elements_4.Elements)

# ----
# Tage
# Tag / Loft
categories_5 = BuiltInCategories(["autodesk.revit.category.local:gbXML_Roof-1.0.0", "autodesk.revit.category.local:roofs-1.0.0"], SearchPattern="Roofs")
catfltr_5 = CategoryFilter(Categories=categories_5, Inverted=False)
andfltr_4 = LogicalAndFilter(FilterA=levelfltr, FilterB=catfltr_5)
elements_5 = QueryElements(Filter=catfltr_5, Limit=antal_elementer_der_tælles_med_i_query_e)  # -> Elements, Count
geometry_4 = ElementGeometry(Elements=elements_5.Elements)

# ----
# Søjler
categories_6 = BuiltInCategories("autodesk.revit.category.family:columns-1.0.0", SearchPattern="Columns")
catfltr_6 = CategoryFilter(Categories=categories_6, Inverted=False)
andfltr_5 = LogicalAndFilter(FilterA=levelfltr, FilterB=catfltr_6)
elements_6 = QueryElements(Filter=andfltr_5, Limit=antal_elementer_der_tælles_med_i_query_e)  # -> Elements, Count
geometry_5 = ElementGeometry(Elements=elements_6.Elements)

# ----
# Sprosser
categories_7 = BuiltInCategories("autodesk.revit.category.local:curtainWallMullions-1.0.0", SearchPattern="Curtain Wall Mullions")
catfltr_7 = CategoryFilter(Categories=categories_7, Inverted=False)
andfltr_6 = LogicalAndFilter(FilterA=levelfltr, FilterB=catfltr_7)
elements_7 = QueryElements(Filter=andfltr_6, Limit=antal_elementer_der_tælles_med_i_query_e)  # -> Elements, Count
geometry_6 = ElementGeometry(Elements=elements_7.Elements)
debrep_2 = DeconstructBrep(Brep=geometry_6)  # -> Faces, Edges, Vertices
planar = IsPlanar(Surface=debrep_2.Faces, Interior=True)  # -> Planar, Plane
cull = CullPattern(List=debrep_2.Faces, CullPattern=planar.Planar)

# ----
# Døre
categories_8 = BuiltInCategories("autodesk.revit.category.family:doors-1.0.0", SearchPattern="doors")
catfltr_8 = CategoryFilter(Categories=categories_8, Inverted=False)
andfltr_7 = LogicalAndFilter(FilterA=levelfltr, FilterB=catfltr_8)
elements_8 = QueryElements(Filter=andfltr_7, Limit=antal_elementer_der_tælles_med_i_query_e)  # -> Elements, Count
geometry_7 = ElementGeometry(Elements=elements_8.Elements)  # -> simplify(flatten(Geometry)), simplify(flatten(Categories))
value_picker = ValuePicker(geometry_7.Categories)
identity = CategoryIdentity(Category=geometry_7.Categories)  # -> Type, Name, IsVisibleUI, IsSubcategory
txt = Text(identity.Name)
txt_2 = Text(identity.Name)
txt_3 = Text(identity.Name)
txt_4 = Text(identity.Name)
tmatch = MatchText(Text=txt_2, Pattern="Doors\Frame/Mullion", Case=True)
tmatch_2 = MatchText(Text=txt, Pattern="Doors\Panel", Case=True)
tmatch_3 = MatchText(Text=txt_3, Pattern="Doors\Glass", Case=True)
tmatch_4 = MatchText(Text=txt_4, Pattern="Windows\Glass", Case=True)
cull_2 = CullPattern(List=geometry_7.Geometry, CullPattern=tmatch)
cull_3 = CullPattern(List=geometry_7.Geometry, CullPattern=tmatch_2)
cull_4 = CullPattern(List=geometry_7.Geometry, CullPattern=tmatch_3)
cull_5 = CullPattern(List=geometry_7.Geometry, CullPattern=tmatch_4)
doors_glass = Geometry(cull_4)
doors_glass_2 = Geometry(cull_5)
debrep_3 = DeconstructBrep(Brep=doors_glass)  # -> Faces, Edges, Vertices
debrep_4 = DeconstructBrep(Brep=doors_glass_2)  # -> Faces, Edges, Vertices
area = Area(Geometry=debrep_3.Faces)  # -> Area, Centroid
area_2 = Area(Geometry=debrep_4.Faces)  # -> Area, Centroid
sort = SortList(Keys=area.Area)  # -> reverse(Keys), ValuesA
sort_2 = SortList(Keys=area_2.Area)  # -> reverse(Keys), ValuesA
item_2 = ListItem(List=sort.Keys, Index=0, Wrap=True)
item_3 = ListItem(List=sort_2.Keys, Index=0, Wrap=True)
mindex = MemberIndex(Set=area.Area, Member=item_2)  # -> Index, Count
mindex_2 = MemberIndex(Set=area_2.Area, Member=item_3)  # -> Index, Count
item_4 = ListItem(List=mindex.Index, Index=0, Wrap=True)
item_5 = ListItem(List=mindex_2.Index, Index=0, Wrap=True)
item_6 = ListItem(List=debrep_3.Faces, Index=item_4, Wrap=True)
item_7 = ListItem(List=debrep_4.Faces, Index=item_5, Wrap=True)
doors_frame_mullion = Geometry(cull_2)
doors_panel = Geometry(cull_3)
doors_glass_3 = CleanTree(RemoveNulls=True, RemoveInvalid=True, RemoveEmpty=False, Tree=item_6)
doors_glass_4 = CleanTree(RemoveNulls=True, RemoveInvalid=True, RemoveEmpty=False, Tree=item_7)
door_glass = Geometry([doors_glass_4, doors_glass_3])
debrep_5 = DeconstructBrep(Brep=doors_panel)  # -> Faces, Edges, Vertices
debrep_6 = DeconstructBrep(Brep=doors_frame_mullion)  # -> Faces, Edges, Vertices
debrep_7 = DeconstructBrep(Brep=door_glass)  # -> Faces, Edges, Vertices
planar_2 = IsPlanar(Surface=debrep_5.Faces, Interior=True)  # -> Planar, Plane
planar_3 = IsPlanar(Surface=debrep_6.Faces, Interior=True)  # -> Planar, Plane
planar_4 = IsPlanar(Surface=debrep_7.Faces, Interior=True)  # -> Planar, Plane
cull_6 = CullPattern(List=debrep_5.Faces, CullPattern=planar_2.Planar)
cull_7 = CullPattern(List=debrep_6.Faces, CullPattern=planar_3.Planar)
cull_8 = CullPattern(List=debrep_7.Faces, CullPattern=planar_4.Planar)

# ----
# Glasvæg
glass_wall_type = Data(element_type_picker)
typefltr = TypeFilter(Types=glass_wall_type, Inverted=False)
andfltr_8 = LogicalAndFilter(FilterA=levelfltr, FilterB=typefltr)
elements_9 = QueryElements(Filter=andfltr_8, Limit=antal_elementer_der_tælles_med_i_query_e)  # -> Elements, Count
geometry_8 = ElementGeometry(Elements=elements_9.Elements)
item_8 = ListItem(List=geometry_8, Index=0, Wrap=True)
debrep_8 = DeconstructBrep(Brep=item_8)  # -> Faces, Edges, Vertices
glass_walls = ListItem(List=debrep_8.Faces, Index=0, Wrap=True)
debrep_9 = DeconstructBrep(Brep=glass_walls)  # -> Faces, Edges, Vertices
planar_5 = IsPlanar(Surface=debrep_9.Faces, Interior=True)  # -> Planar, Plane
cull_9 = CullPattern(List=debrep_9.Faces, CullPattern=planar_5.Planar)

mindex_3 = MemberIndex(Set=elements_2.Elements, Member=elements_9.Elements)  # -> flatten(Index), Count
cull_i = CullIndex(List=elements_2.Elements, Indices=mindex_3.Index, Wrap=True)
a_bwt = AnalyzeBasicWallType(BasicWallType=cull_i)  # -> Structure, WrappingAtInserts, WrappingAtEnds, Width, Function
wf = WallFunction({"Interior": 0, "Exterior": 1, "Foundation": 2, "Retaining": 3, "Soffit": 4, "Core-Shaft": 5}, selected="Interior")
wf_2 = WallFunction({"Interior": 0, "Exterior": 1, "Foundation": 2, "Retaining": 3, "Soffit": 4, "Core-Shaft": 5}, selected="Exterior")
equals = Equality(FirstNumber=a_bwt.Function, SecondNumber=wf)  # -> Equality, Inequality
equals_2 = Equality(FirstNumber=a_bwt.Function, SecondNumber=wf_2)  # -> Equality, Inequality
cull_10 = CullPattern(List=cull_i, CullPattern=equals.Equality)
cull_11 = CullPattern(List=cull_i, CullPattern=equals_2.Equality)
geometry_9 = ElementGeometry(Elements=cull_10)
geometry_10 = ElementGeometry(Elements=cull_11)
faces = HostFaces(Host=cull_11)  # -> Top, Bottom, Exterior, Interior
exterior_walls = Geometry(geometry_10)
exterior_face = Geometry(faces.Exterior)
debrep_10 = DeconstructBrep(Brep=[exterior_walls, exterior_face])  # -> flatten(Faces), Edges, Vertices
debrep_11 = DeconstructBrep(Brep=exterior_face)  # -> Faces, Edges, Vertices
area_3 = Area(Geometry=debrep_10.Faces)  # -> Area, Centroid
cullpt = CullDuplicates(Points=area_3.Centroid, Tolerance="0.01", CullMode=3)  # -> Points, Indices, Valence
item_9 = ListItem(List=debrep_10.Faces, Index=cullpt.Indices, Wrap=True)
interior_face_walls = Geometry([geometry_9, item_9])
exterior_wall_face = Geometry(debrep_11.Faces)

txt_5 = Text(identity.Name)
tmatch_5 = MatchText(Text=txt_5, Pattern="Windows\Frame/Mullion", Case=True)
cull_12 = CullPattern(List=geometry_7.Geometry, CullPattern=tmatch_5)
doors_frame_mullion_2 = Geometry(cull_12)
debrep_12 = DeconstructBrep(Brep=doors_frame_mullion_2)  # -> Faces, Edges, Vertices
planar_6 = IsPlanar(Surface=debrep_12.Faces, Interior=True)  # -> Planar, Plane
cull_13 = CullPattern(List=debrep_12.Faces, CullPattern=planar_6.Planar)

# ---- group: GULV OVERFLADER
br18_standard_reflektans_gulvflader = Panel("0.20")
br18_navn = Panel("BR18_Gulv")
opaquemod_3 = HBOpaqueModifier(name=br18_navn, reflect=br18_standard_reflektans_gulvflader)  # -> modifier; plug-in component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
floors = Geometry(geometry_3)
face = HBFace(geo=floors, name="Floor", type="Floor", rad_mod=opaquemod_3)  # -> report, faces; plug-in component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

# ---- group: Vægoverflader - Udvendig
br18_standard_reflektans_væg_udvendig = Panel("0.20")
br18_navn_2 = Panel("BR18_Vaeg_udvendig")
opaquemod_4 = HBOpaqueModifier(name=br18_navn_2, reflect=br18_standard_reflektans_væg_udvendig)  # -> modifier; plug-in component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
exterior_walls_surfaces = Geometry(exterior_wall_face)
# BEREGNING
face_2 = HBFace(geo=exterior_walls_surfaces, name="Wall exterior face", type="Wall", rad_mod=opaquemod_4)  # -> report, faces; plug-in component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

# ---- group: VÆG OVERFLADER INDVENDIG
br18_standard_reflektans_væg = Panel("0.50")
br18_navn_3 = Panel("BR18_Vaeg_Indvendig")
opaquemod_5 = HBOpaqueModifier(name=br18_navn_3, reflect=br18_standard_reflektans_væg)  # -> modifier; plug-in component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
interior_walls_surfaces = Geometry([interior_face_walls, geometry_5])
face_3 = HBFace(geo=interior_walls_surfaces, name="Wall interior face", type="Wall", rad_mod=opaquemod_5)  # -> report, faces; plug-in component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

# ---- group: TAG & LOFT OVERFLADER
br18_standard_reflektans_gulv = Panel("0.70")
br18_navn_4 = Panel("BR18_Loft")
opaquemod_6 = HBOpaqueModifier(name=br18_navn_4, reflect=br18_standard_reflektans_gulv)  # -> modifier; plug-in component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
roofs = Geometry(geometry_4)
lofts = Geometry(geometry_2)
face_4 = HBFace(geo=[roofs, lofts], name="roofceiling", type="roofceiling", rad_mod=opaquemod_6)  # -> report, faces; plug-in component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

# ---- group: Specifik rumanalyse
rooms_3 = QueryRooms(Placed=True, Enclosed=True)
data = Data(rooms_3)

# ---- group: Specifik rum analyse
# 2.4 - HØJDE AF ANALYSEFLADE
# Dette har betydning for analysefaldens højde.
# I en bolig analyseres overfladen i 500 mm. over
# gulvflade og i arbejdsrum analyseres i 850 mm.
# over gulvfalden.
list_9 = ItemSelector(
    data,
    {"Revit Room : Master Bedroom 206 : id 857191", "Revit Room : Master Bath 207 : id 857194", "Revit Room : Bedroom 204 : id 857197", "Revit Room : Bath 203 : id 857200", "Revit Room : Bath 205 : id 857203", "Revit Room : Bedroom 202 : id 857206", "Revit Room : Entry Hall 201 : id 857209", "Revit Room : Kitchen & Dining 101 : id 857279", "Revit Room : Laundry 104 : id 857292", "Revit Room : Bath 103 : id 857346", "Revit Room : Hall 105 : id 857545", "Revit Room : Living 106 : id 857552", "Revit Room : Mech. 102 : id 906922", "Revit Room : Linen 208 : id 940325"}, selected=["Revit Room : Kitchen & Dining 101 : id 857279", "Revit Room : Living 106 : id 857552"])
list_10 = ValueList({"Bolig - 500 mm.": 500, "Arbejdsrum 850 mm": 850}, selected="Bolig - 500 mm.")

# ---- group: Specifik rumanalyse (continued)
room = Room(list_9)
liste_med_udvalgte_rum = Panel(room)
debrep_13 = DeconstructBrep(Brep=room)  # -> Faces, Edges, Vertices
udvælgelse_af_nederste_face_2 = UdvælgelseAfNedersteFace(S=debrep_13.Faces)
item_10 = ListItem(List=debrep_13.Faces, Index=udvælgelse_af_nederste_face_2, Wrap=True)

# ----
# OPRETTELSE AF ANALYSEMODEL
geo = Geometry(item_10)

# ---- group: ETAGE ANALYSE - Opsætning af analyseflade afstand til vægge + justering af analysegrid / DANNELSE AF ANALYSEFLADER
full_level = Geometry(item)  # disabled
debrep_14 = DeconstructBrep(Brep=[full_level, geo])  # -> Faces, Edges, Vertices
line = Line(debrep_14.Edges)
boundary = BoundarySurfaces(Edges=line)
medges = MeshEdges(Mesh=boundary)  # -> NakedEdges, InteriorEdges, NonManifoldEdges
join = JoinCurves(Curves=medges.NakedEdges, Preserve=False)

# ---- group: ETAGE ANALYSE - Opsætning af analyseflade afstand til vægge + justering af analysegrid
polyoffset = PolylineOffset(
    Polylines=join,
    Distance=Slider(500, range=0..1000),
    Plane=Plane(origin=(0, 0, 0), x=(0, 0, 0), y=(0, 0, 0)),
    Tolerance=0.1595272236,
    ClosedFillet=1,
    OpenFillet=1,
    Miter=2)  # -> Contour, Holes
clean = CleanTree(RemoveNulls=True, RemoveInvalid=True, RemoveEmpty=Toggle(True), Tree=polyoffset.Holes)
boundary_2 = BoundarySurfaces(Edges=clean)

# ---- group: ETAGE ANALYSE - Opsætning af analyseflade afstand til vægge + justering af analysegrid / Overflade håndtering / Flip af mulige forkertvendte overflader
vec = VectorXYZ(XComponent=0, YComponent=0, ZComponent=0)  # -> Vector, Length
evalsrf = EvaluateSurface(Surface=boundary_2, Point=vec.Vector)  # -> Point, Normal, UDirection, VDirection, Frame
vec_2 = VectorXYZ(XComponent=0, YComponent=0, ZComponent="-1")  # -> Vector, Length
mindex_4 = MemberIndex(Set=evalsrf.Normal, Member=vec_2.Vector)  # -> Index, Count
bool = Boolean(mindex_4.Count)
bool_2 = Boolean(invert(mindex_4.Count))
cull_14 = CullPattern(List=boundary_2, CullPattern=bool)
cull_15 = CullPattern(List=boundary_2, CullPattern=bool_2)
flip = Flip(Surface=cull_14)  # -> Surface, Result
srf = Surface(cull_15)
merge = Merge(Data1=flip.Surface, Data2=srf)

# ---- group: ETAGE ANALYSE - Opsætning af analyseflade afstand til vægge + justering af analysegrid / Overflade håndtering / Test af overflade normal (Overflade retning)
evalsrf_2 = EvaluateSurface(Surface=merge, Point=vec.Vector)  # -> Point, Normal, UDirection, VDirection, Frame
pcen = PolygonCenter(Polyline=boundary_2)  # -> CenterV, CenterE, CenterA
multiplication = Multiplication(A=evalsrf_2.Normal, B=Slider(2000, range=0..10000))
vdisex = VectorDisplayEx(Point=pcen.CenterE, Vector=multiplication, Colour=RGB(0, 0, 0), Width=Slider(5, range=0..10))

# ---- group: ETAGE ANALYSE - Opsætning af analyseflade afstand til vægge + justering af analysegrid / Forskydning af analsyeflade
analysehøjde = Panel([list_4, list_10])
Z = UnitZ(Factor=analysehøjde)
move = Move(Geometry=merge, Motion=Z)  # -> Geometry, Transform

# ---- group: LT-værdi 1
# Vinduer
categories_9 = BuiltInCategories("autodesk.revit.category.family:windows-1.0.0", SearchPattern="Windows")
catfltr_9 = CategoryFilter(Categories=categories_9, Inverted=False)
andfltr_9 = LogicalAndFilter(FilterA=levelfltr, FilterB=catfltr_9)
elements_10 = QueryElements(Filter=andfltr_9, Limit=antal_elementer_der_tælles_med_i_query_e)  # -> Elements, Count
panel_8 = Panel("Windows\Frame/Mullion")
panel_9 = Panel("Windows\Glass")

# ----
list_11 = ValueList({"Tilføj ekstra LT-værdi": True, "1 LT-værdi": False}, selected="1 LT-værdi")
lt_rudetype_2 = Slider(0.5, range=0..1)  # disabled
onoff_6 = EnableDisableObject(
    Enabled=list_11,
    AllObjects_Object=[element_type_picker_2, elements_11, typefltr_2, andfltr_10, geometry_11, value_picker_2, identity_2, tmatch_6, txt_7, cull_16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])
element_type_picker_2 = ElementTypePicker(
    categories_9,
    {"M_Skylight : 1180 x 1170mm": "e340d1fc-19c1-4200-9ff0-415bc126641d:4269d745-d78a-4cca-860f-a55b170715ad-000775a0", "Single Window : Standard": "e340d1fc-19c1-4200-9ff0-415bc126641d:ef57b02a-5e81-49e7-93bb-ae5f002d921c-000306de"}, selected=[])  # disabled

# ---- group: LT-værdi 2
typefltr_2 = TypeFilter(Types=element_type_picker_2, Inverted=False)  # disabled
andfltr_10 = LogicalAndFilter(FilterA=levelfltr, FilterB=typefltr_2)  # disabled
elements_11 = QueryElements(Filter=andfltr_10, Limit=antal_elementer_der_tælles_med_i_query_e)  # -> Elements, Count; disabled
geometry_11 = ElementGeometry(Elements=elements_11.Elements)  # -> Elements, simplify(flatten(Geometry)), simplify(flatten(Categories)); disabled
identity_2 = CategoryIdentity(Category=geometry_11.Categories)  # -> Type, Name, IsVisibleUI, IsSubcategory; disabled
value_picker_2 = ValuePicker(geometry_11.Categories)  # disabled
txt_6 = Text(identity_2.Name)  # disabled
txt_7 = Text(identity_2.Name)  # disabled
tmatch_6 = MatchText(Text=txt_7, Pattern=panel_8, Case=True)  # disabled
tmatch_7 = MatchText(Text=txt_6, Pattern=panel_9, Case=True)  # disabled
cull_16 = CullPattern(List=geometry_11.Geometry, CullPattern=tmatch_6)  # disabled
cull_17 = CullPattern(List=geometry_11.Geometry, CullPattern=tmatch_7)  # disabled
windows_glass = Geometry(cull_17)  # disabled
debrep_15 = DeconstructBrep(Brep=windows_glass)  # -> Faces, Edges, Vertices; disabled
area_4 = Area(Geometry=debrep_15.Faces)  # -> Area, Centroid; disabled
sort_3 = SortList(Keys=area_4.Area)  # -> reverse(Keys), ValuesA; disabled
item_11 = ListItem(List=sort_3.Keys, Index=0, Wrap=True)  # disabled
mindex_5 = MemberIndex(Set=area_4.Area, Member=item_11)  # -> Index, Count; disabled
item_12 = ListItem(List=mindex_5.Index, Index=0, Wrap=True)  # disabled
item_13 = ListItem(List=debrep_15.Faces, Index=item_12, Wrap=True)  # disabled
frame_mullion = Geometry(cull_16)  # disabled
windows_glass_2 = CleanTree(RemoveNulls=True, RemoveInvalid=True, RemoveEmpty=False, Tree=item_13)  # disabled
debrep_16 = DeconstructBrep(Brep=frame_mullion)  # -> Faces, Edges, Vertices; disabled
debrep_17 = DeconstructBrep(Brep=windows_glass_2)  # -> Faces, Edges, Vertices; disabled
planar_7 = IsPlanar(Surface=debrep_16.Faces, Interior=True)  # -> Planar, Plane; disabled
planar_8 = IsPlanar(Surface=debrep_17.Faces, Interior=True)  # -> Planar, Plane; disabled
cull_18 = CullPattern(List=debrep_16.Faces, CullPattern=planar_7.Planar)  # disabled
cull_19 = CullPattern(List=debrep_17.Faces, CullPattern=planar_8.Planar)  # disabled

# ----
lt_2 = Number(lt_rudetype_2)

# ---- group: GLAS OVERFLADER - LT-værdi 2
lt_value_2 = Panel("Window glazing 2")
toggle_7 = BooleanToggle(True)
glas = Brep(cull_19)
glassmod = HBGlassModifier(name=lt_value_2, trans=lt_2)  # -> modifier; plug-in component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
clean_2 = CleanTree(RemoveNulls=toggle_7, RemoveInvalid=True, RemoveEmpty=toggle_7, Tree=glas)
aperture = HBAperture(geo=clean_2, name="Window glazing LT 2", rad_mod=glassmod)  # -> report, apertures; plug-in component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

# ---- group: LT-værdi 3
exclude = ExclusionFilter(Elements=element_type_picker_2, Inverted=False)  # disabled
types = QueryTypes(Kind=3, Category=categories_9, Filter=exclude)  # disabled
type = Type(types)

# ----
list_12 = ValueList({"Tilføj ekstra LT-værdi": True, "2 LT-værdier": False}, selected="2 LT-værdier")
lt_rudetype_3 = Slider(0.7, range=0..1)  # disabled
onoff_7 = EnableDisableObject(
    Enabled=list_12,
    AllObjects_Object=[element_type_picker_3, elements_12, typefltr_3, andfltr_11, geometry_12, value_picker_3, identity_3, tmatch_8, txt_8, cull_20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])
element_type_picker_3 = ElementTypePicker(type)  # disabled

# ---- group: LT-værdi 3 (continued)
typefltr_3 = TypeFilter(Types=element_type_picker_3, Inverted=False)  # disabled
andfltr_11 = LogicalAndFilter(FilterA=levelfltr, FilterB=typefltr_3)  # disabled
elements_12 = QueryElements(Filter=andfltr_11, Limit=antal_elementer_der_tælles_med_i_query_e)  # -> Elements, Count; disabled
geometry_12 = ElementGeometry(Elements=elements_12.Elements)  # -> Elements, simplify(flatten(Geometry)), simplify(flatten(Categories)); disabled
identity_3 = CategoryIdentity(Category=geometry_12.Categories)  # -> Type, Name, IsVisibleUI, IsSubcategory; disabled
value_picker_3 = ValuePicker(geometry_12.Categories)  # disabled
txt_8 = Text(identity_3.Name)  # disabled
txt_9 = Text(identity_3.Name)  # disabled
tmatch_8 = MatchText(Text=txt_8, Pattern=panel_8, Case=True)  # disabled
tmatch_9 = MatchText(Text=txt_9, Pattern=panel_9, Case=True)  # disabled
cull_20 = CullPattern(List=geometry_12.Geometry, CullPattern=tmatch_8)  # disabled
cull_21 = CullPattern(List=geometry_12.Geometry, CullPattern=tmatch_9)  # disabled
windows_glass_3 = Geometry(cull_21)  # disabled
debrep_18 = DeconstructBrep(Brep=windows_glass_3)  # -> Faces, Edges, Vertices; disabled
area_5 = Area(Geometry=debrep_18.Faces)  # -> Area, Centroid; disabled
sort_4 = SortList(Keys=area_5.Area)  # -> reverse(Keys), ValuesA; disabled
item_14 = ListItem(List=sort_4.Keys, Index=0, Wrap=True)  # disabled
mindex_6 = MemberIndex(Set=area_5.Area, Member=item_14)  # -> Index, Count; disabled
item_15 = ListItem(List=mindex_6.Index, Index=0, Wrap=True)  # disabled
item_16 = ListItem(List=debrep_18.Faces, Index=item_15, Wrap=True)  # disabled
frame_mullion_2 = Geometry(cull_20)  # disabled
windows_glass_4 = CleanTree(RemoveNulls=True, RemoveInvalid=True, RemoveEmpty=False, Tree=item_16)  # disabled
debrep_19 = DeconstructBrep(Brep=frame_mullion_2)  # -> Faces, Edges, Vertices; disabled
debrep_20 = DeconstructBrep(Brep=windows_glass_4)  # -> Faces, Edges, Vertices; disabled
planar_9 = IsPlanar(Surface=debrep_19.Faces, Interior=True)  # -> Planar, Plane; disabled
planar_10 = IsPlanar(Surface=debrep_20.Faces, Interior=True)  # -> Planar, Plane; disabled
cull_22 = CullPattern(List=debrep_19.Faces, CullPattern=planar_9.Planar)  # disabled
cull_23 = CullPattern(List=debrep_20.Faces, CullPattern=planar_10.Planar)  # disabled

# ---- group: LT-værdi 1 (continued)
geometry_13 = ElementGeometry(Elements=elements_10.Elements, Exclude=flatten([elements_11.Elements, elements_12.Elements]))  # -> simplify(flatten(Geometry)), simplify(flatten(Categories))
value_picker_4 = ValuePicker(geometry_13.Categories)
identity_4 = CategoryIdentity(Category=geometry_13.Categories)  # -> Type, Name, IsVisibleUI, IsSubcategory
txt_10 = Text(identity_4.Name)
txt_11 = Text(identity_4.Name)
tmatch_10 = MatchText(Text=txt_11, Pattern=panel_8, Case=True)
tmatch_11 = MatchText(Text=txt_10, Pattern=panel_9, Case=True)
cull_24 = CullPattern(List=geometry_13.Geometry, CullPattern=tmatch_10)
cull_25 = CullPattern(List=geometry_13.Geometry, CullPattern=tmatch_11)
doors_glass_5 = Geometry(cull_25)
debrep_21 = DeconstructBrep(Brep=doors_glass_5)  # -> Faces, Edges, Vertices
area_6 = Area(Geometry=debrep_21.Faces)  # -> Area, Centroid
sort_5 = SortList(Keys=area_6.Area)  # -> reverse(Keys), ValuesA
item_17 = ListItem(List=sort_5.Keys, Index=0, Wrap=True)
mindex_7 = MemberIndex(Set=area_6.Area, Member=item_17)  # -> Index, Count
item_18 = ListItem(List=mindex_7.Index, Index=0, Wrap=True)
item_19 = ListItem(List=debrep_21.Faces, Index=item_18, Wrap=True)
frame_mullion_3 = Geometry(cull_24)
windows_glass_5 = CleanTree(RemoveNulls=True, RemoveInvalid=True, RemoveEmpty=False, Tree=item_19)
debrep_22 = DeconstructBrep(Brep=frame_mullion_3)  # -> Faces, Edges, Vertices
debrep_23 = DeconstructBrep(Brep=windows_glass_5)  # -> Faces, Edges, Vertices
planar_11 = IsPlanar(Surface=debrep_22.Faces, Interior=True)  # -> Planar, Plane
planar_12 = IsPlanar(Surface=debrep_23.Faces, Interior=True)  # -> Planar, Plane
cull_26 = CullPattern(List=debrep_22.Faces, CullPattern=planar_11.Planar)
cull_27 = CullPattern(List=debrep_23.Faces, CullPattern=planar_12.Planar)

# ---- group: MASSIV DØR OG KARM OVERFALDE
br18_standard_reflektans_rammersprosser = Panel("0.70")
br18_navn_5 = Panel("BR18_RammerSprosser")
opaquemod_7 = HBOpaqueModifier(name=br18_navn_5, reflect=br18_standard_reflektans_rammersprosser)  # -> modifier; plug-in component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
rammer_sprosser = Geometry(flatten([cull_26, cull, cull_7, cull_22, cull_18, cull_13]))
door_panel = Geometry(cull_6)
face_5 = HBFace(geo=rammer_sprosser, name="frames", rad_mod=opaquemod_7)  # -> report, faces; plug-in component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
door = HBDoor(geo=door_panel, name="Door massive", rad_mod=opaquemod_7)  # -> report, doors; plug-in component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

# ----
lt_3 = Number(lt_rudetype_3)  # disabled

# ---- group: GLAS OVERFLADER - LT-værdi 3
lt_value_3 = Panel("Window Glazing 3")
toggle_8 = BooleanToggle(True)
glas_2 = Brep(cull_23)
glassmod_2 = HBGlassModifier(name=lt_value_3, trans=lt_3)  # -> modifier; plug-in component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
clean_3 = CleanTree(RemoveNulls=toggle_8, RemoveInvalid=True, RemoveEmpty=toggle_8, Tree=glas_2)
aperture_2 = HBAperture(geo=clean_3, name="Window glazing LT 3", rad_mod=glassmod_2)  # -> report, apertures; plug-in component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

# ----
# Glas
categories_10 = BuiltInCategories("autodesk.revit.category.family:curtainWallPanels-1.0.0", SearchPattern="Curtain Panels")
catfltr_10 = CategoryFilter(Categories=categories_10, Inverted=False)
andfltr_12 = LogicalAndFilter(FilterA=levelfltr, FilterB=catfltr_10)
elements_13 = QueryElements(Filter=andfltr_12, Limit=antal_elementer_der_tælles_med_i_query_e)  # -> Elements, Count
geometry_14 = ElementGeometry(Elements=elements_13.Elements)
debrep_24 = DeconstructBrep(Brep=geometry_14)  # -> Faces, Edges, Vertices

# ---- group: Detaljeret rum analyse / Samlet og frasorterede rum
rooms_4 = QueryRooms(Placed=True, Enclosed=True)  # disabled
liste_med_alle_rum_i_modellen = Panel(rooms_4)  # disabled

# ----
# Curtain Walls
area_7 = Area(Geometry=debrep_24.Faces)  # -> Area, Centroid
sort_6 = SortList(Keys=area_7.Area)  # -> reverse(Keys), ValuesA
item_20 = ListItem(List=sort_6.Keys, Index=0, Wrap=True)

mindex_8 = MemberIndex(Set=area_7.Area, Member=item_20)  # -> Index, Count

item_21 = ListItem(List=mindex_8.Index, Index=0, Wrap=True)

glas_3 = ListItem(List=debrep_24.Faces, Index=item_21, Wrap=True)
debrep_25 = DeconstructBrep(Brep=glas_3)  # -> Faces, Edges, Vertices
planar_13 = IsPlanar(Surface=debrep_25.Faces, Interior=True)  # -> Planar, Plane
cull_28 = CullPattern(List=debrep_25.Faces, CullPattern=planar_13.Planar)

# ---- group: GLAS OVERFLADER - LT-værdi 1
toggle_9 = BooleanToggle(True)
glas_4 = Brep([cull_27, cull_28, cull_9])
glassmod_3 = HBGlassModifier(name="Glazing", trans=lt_1)  # -> modifier; plug-in component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
clean_4 = CleanTree(RemoveNulls=toggle_9, RemoveInvalid=True, RemoveEmpty=toggle_9, Tree=glas_4)
door_glass_2 = Geometry(cull_8)
aperture_3 = HBAperture(geo=clean_4, name="Window glazing", rad_mod=glassmod_3)  # -> report, apertures; plug-in component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
door_2 = HBDoor(geo=door_glass_2, name="Door glass", glass=Toggle(True), rad_mod=glassmod_3)  # -> report, doors; plug-in component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

# ---- group: HB MODEL
# DANNELSE AF MODEL: Alt den indsamlede geomtri og dens relevante overfalde reflektantser, samles til en samlet Honeybee  analysemodel [HB Model] der nu kan bruges til analyser
model = HBModel(
    faces=flatten([face_3.faces, face.faces, face_5.faces, face_4.faces, face_2.faces]),
    shades=flatten([shade.shades, shade_2.shades]),
    apertures=flatten([aperture_3.apertures, aperture.apertures, aperture_2.apertures]),
    doors=flatten([door.doors, door_2.doors]),
    name=definer_projektets_navn)  # -> report, model; plug-in component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

# ----
hvis_tom_er_der_ikke_problemer_med_model = Panel(model.report)  # "Hvis tom er der ikke problemer med modellen"

# ---- group: Visning af geometri
tænd_sluk_3 = BooleanToggle(False)
tænd_sluk_4 = BooleanToggle(False)
vis_ydervæg_overflade = HideShowObjectPreview(Visible=tænd_sluk_3, AllObjects_Object=[preview_2, preview])
vis_fuld_bygningsmodel = HideShowObjectPreview(
    Visible=tænd_sluk_4,
    AllObjects_Object=[geometry_3, glass_walls, geometry_4, geometry_2, geometry_5, glas_3, geometry_6, doors_panel, doors_frame_mullion, frame_mullion_3, windows_glass_5, door_glass, interior_face_walls, exterior_wall_face, geometry])
exterior_walls_surfaces_2 = Geometry(exterior_wall_face)
interior_walls_surfaces_2 = Geometry(interior_face_walls)
curtain_walls = Geometry([cull_9, cull_28, cull])
vinduer = Geometry([cull_26, cull_27, cull_19, cull_18])
doors = Geometry([cull_6, cull_7, cull_8])
floor = Geometry(geometry_3)
walls = Geometry(elements_2.Elements)
preview = CustomPreview(Geometry=interior_walls_surfaces_2, Material=ColourSwatch(SwatchColor=RGB(230, 230, 230)))
preview_2 = CustomPreview(Geometry=exterior_walls_surfaces_2, Material=ColourSwatch(SwatchColor=RGBA(255, 85, 0, 250)))
preview_3 = CustomPreview(Geometry=[curtain_walls, vinduer, doors], Material=ColourSwatch(SwatchColor=RGB(255, 0, 0)))
preview_4 = CustomPreview(Geometry=walls, Material=ColourSwatch(SwatchColor=RGB(128, 128, 128)))
preview_5 = CustomPreview(Geometry=floor, Material=ColourSwatch(SwatchColor=RGB(255, 255, 255)))

# ----
# OPSÆTNING
# Analyse af specfikke rum
list_13 = ValueList({"Specifik rum analyse": True, "Detaljeret rum analyse": False}, selected="Specifik rum analyse")
not_3 = GateNot(A=list_13)
onoff_8 = EnableDisableObject(Enabled=not_3, AllObjects_Object=[rooms_5, rooms_4, resterende_rum, mindex_11, rooms_6, panel_12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])
onoff_9 = EnableDisableObject(Enabled=list_13, AllObjects_Object=[list_9, list_10, geo])

# ---- group: Detaljeret rum analyse
indtast_rumnavn_i_500_mm_analysehøjde = Panel("")  # disabled

# ---- group: Detaljeret rum analyse / Rum gruppering 1 - Analysehøjde 500 mm
rum_m_500_mm_analysehøjde = Panel(indtast_rumnavn_i_500_mm_analysehøjde)  # disabled
rooms_5 = QueryRooms(Placed=True, Name=rum_m_500_mm_analysehøjde, Enclosed=True)  # disabled
debrep_26 = DeconstructBrep(Brep=rooms_5)  # -> Faces, Edges, Vertices; disabled
panel_10 = Panel(rooms_5)  # disabled
udvælgelse_af_nederste_face_3 = UdvælgelseAfNedersteFace(S=debrep_26.Faces)  # disabled
item_22 = ListItem(List=debrep_26.Faces, Index=udvælgelse_af_nederste_face_3, Wrap=True)  # disabled

# ---- group: Detaljeret rum analyse (continued)
rum_der_er_udvalgt_til_analysen_analyse = Panel(rooms_5)  # "Rum der er udvalgt til analysen - Analyse flade over gulv 500 mm"; disabled

# ---- group: UDVALGTERUM i 500 mm - Opsætning af analyseflade afstand til vægge + justering af analysegrid / DANNELSE AF ANALYSEFLADER
selected_rooms = Geometry(item_22)  # disabled
debrep_27 = DeconstructBrep(Brep=selected_rooms)  # -> Faces, Edges, Vertices; disabled
line_2 = Line(debrep_27.Edges)
boundary_3 = BoundarySurfaces(Edges=line_2)
medges_2 = MeshEdges(Mesh=boundary_3)  # -> NakedEdges, InteriorEdges, NonManifoldEdges; disabled
join_2 = JoinCurves(Curves=medges_2.NakedEdges, Preserve=False)  # disabled

# ---- group: UDVALGTERUM i 500 mm - Opsætning af analyseflade afstand til vægge + justering af analysegrid
number_slider_4 = Slider(500, range=0..1000)  # disabled
polyoffset_2 = PolylineOffset(
    Polylines=join_2,
    Distance=number_slider_4,
    Plane=Plane(origin=(0, 0, 0), x=(0, 0, 0), y=(0, 0, 0)),
    Tolerance=0.1595272236,
    ClosedFillet=1,
    OpenFillet=1,
    Miter=2)  # -> Contour, Holes; disabled
toggle_10 = BooleanToggle(True)  # disabled
clean_5 = CleanTree(RemoveNulls=True, RemoveInvalid=True, RemoveEmpty=toggle_10, Tree=polyoffset_2.Holes)  # disabled
boundary_4 = BoundarySurfaces(Edges=clean_5)  # disabled

# ---- group: UDVALGTERUM i 500 mm - Opsætning af analyseflade afstand til vægge + justering af analysegrid / Overflade håndtering / Flip af mulige forkertvendte overflader
vec_3 = VectorXYZ(XComponent=0, YComponent=0, ZComponent=0)  # -> Vector, Length; disabled
evalsrf_3 = EvaluateSurface(Surface=boundary_4, Point=vec_3.Vector)  # -> Point, Normal, UDirection, VDirection, Frame; disabled
panel_11 = Panel("-1")  # disabled
vec_4 = VectorXYZ(XComponent=0, YComponent=0, ZComponent=panel_11)  # -> Vector, Length; disabled
mindex_9 = MemberIndex(Set=evalsrf_3.Normal, Member=vec_4.Vector)  # -> Index, Count; disabled
bool_3 = Boolean(invert(mindex_9.Count))  # disabled
bool_4 = Boolean(mindex_9.Count)  # disabled
cull_29 = CullPattern(List=boundary_4, CullPattern=bool_4)  # disabled
cull_30 = CullPattern(List=boundary_4, CullPattern=bool_3)  # disabled
flip_2 = Flip(Surface=cull_29)  # -> Surface, Result; disabled
srf_2 = Surface(cull_30)  # disabled
merge_2 = Merge(Data1=flip_2.Surface, Data2=srf_2)  # disabled

# ---- group: UDVALGTERUM i 500 mm - Opsætning af analyseflade afstand til vægge + justering af analysegrid / Overflade håndtering / Test af overflade normal (Overflade retning)
evalsrf_4 = EvaluateSurface(Surface=merge_2, Point=vec_3.Vector)  # -> Point, Normal, UDirection, VDirection, Frame; disabled
number_slider_5 = Slider(2000, range=0..10000)  # disabled
number_slider_6 = Slider(5, range=0..10)  # disabled
pcen_2 = PolygonCenter(Polyline=boundary_4)  # -> CenterV, CenterE, CenterA; disabled
multiplication_2 = Multiplication(A=evalsrf_4.Normal, B=number_slider_5)  # disabled
vdisex_2 = VectorDisplayEx(Point=pcen_2.CenterE, Vector=multiplication_2, Colour=RGB(0, 0, 0), Width=number_slider_6)  # disabled

# ---- group: UDVALGTERUM i 500 mm - Opsætning af analyseflade afstand til vægge + justering af analysegrid / Forskydning af analyseflade
lng = ListLength(List=selected_rooms)
bolig_og_hotelværelser = Panel("500")  # disabled
larger = LargerThan(FirstNumber=lng, SecondNumber="0")  # -> LargerThan, OrEqualTo
Z_2 = UnitZ(Factor=bolig_og_hotelværelser)  # disabled
onoff_10 = EnableDisableObject(Enabled=larger.LargerThan, AllObjects_Object=move_2)
move_2 = Move(Geometry=merge_2, Motion=Z_2)  # -> Geometry, Transform; disabled

# ---- group: Detaljeret rum analyse
indtast_rumnavn_i_850_mm_analysehøjde = Panel("")  # disabled

# ---- group: Detaljeret rum analyse / Rum gruppering 2 - Analysehøjde 850 mm
rum_m_850_mm_analysehøjde = Panel(indtast_rumnavn_i_850_mm_analysehøjde)  # disabled
rooms_6 = QueryRooms(Placed=True, Name=rum_m_850_mm_analysehøjde, Enclosed=True)  # disabled
debrep_28 = DeconstructBrep(Brep=rooms_6)  # -> Faces, Edges, Vertices; disabled
panel_12 = Panel(rooms_6)  # disabled
udvælgelse_af_nederste_face_4 = UdvælgelseAfNedersteFace(S=debrep_28.Faces)  # disabled
item_23 = ListItem(List=debrep_28.Faces, Index=udvælgelse_af_nederste_face_4, Wrap=True)  # disabled

# ---- group: Detaljeret rum analyse (continued)
rum_der_er_udvalgt_til_analysen_analyse_2 = Panel(rooms_6)  # "Rum der er udvalgt til analysen - Analyse flade over gulv 850 mm"; disabled

# ---- group: UDVALGTERUM i 850 mm - Opsætning af analyseflade afstand til vægge + justering af analysegrid / DANNELSE AF ANALYSEFLADER
selected_rooms_2 = Geometry(item_23)  # disabled
debrep_29 = DeconstructBrep(Brep=selected_rooms_2)  # -> Faces, Edges, Vertices; disabled
line_3 = Line(debrep_29.Edges)
boundary_5 = BoundarySurfaces(Edges=line_3)
medges_3 = MeshEdges(Mesh=boundary_5)  # -> NakedEdges, InteriorEdges, NonManifoldEdges; disabled
join_3 = JoinCurves(Curves=medges_3.NakedEdges, Preserve=False)  # disabled

# ---- group: UDVALGTERUM i 850 mm - Opsætning af analyseflade afstand til vægge + justering af analysegrid
number_slider_7 = Slider(500, range=0..1000)  # disabled
polyoffset_3 = PolylineOffset(
    Polylines=join_3,
    Distance=number_slider_7,
    Plane=Plane(origin=(0, 0, 0), x=(0, 0, 0), y=(0, 0, 0)),
    Tolerance=0.1595272236,
    ClosedFillet=1,
    OpenFillet=1,
    Miter=2)  # -> Contour, Holes; disabled
toggle_11 = BooleanToggle(True)  # disabled
clean_6 = CleanTree(RemoveNulls=True, RemoveInvalid=True, RemoveEmpty=toggle_11, Tree=polyoffset_3.Holes)  # disabled
boundary_6 = BoundarySurfaces(Edges=clean_6)  # disabled

# ---- group: UDVALGTERUM i 850 mm - Opsætning af analyseflade afstand til vægge + justering af analysegrid / Overflade håndtering / Flip af mulige forkertvendte overflader
vec_5 = VectorXYZ(XComponent=0, YComponent=0, ZComponent=0)  # -> Vector, Length; disabled
evalsrf_5 = EvaluateSurface(Surface=boundary_6, Point=vec_5.Vector)  # -> Point, Normal, UDirection, VDirection, Frame; disabled
panel_13 = Panel("-1")  # disabled
vec_6 = VectorXYZ(XComponent=0, YComponent=0, ZComponent=panel_13)  # -> Vector, Length; disabled
mindex_10 = MemberIndex(Set=evalsrf_5.Normal, Member=vec_6.Vector)  # -> Index, Count; disabled
bool_5 = Boolean(invert(mindex_10.Count))  # disabled
bool_6 = Boolean(mindex_10.Count)  # disabled
cull_31 = CullPattern(List=boundary_6, CullPattern=bool_6)  # disabled
cull_32 = CullPattern(List=boundary_6, CullPattern=bool_5)  # disabled
flip_3 = Flip(Surface=cull_31)  # -> Surface, Result; disabled
srf_3 = Surface(cull_32)  # disabled
merge_3 = Merge(Data1=flip_3.Surface, Data2=srf_3)  # disabled

# ---- group: UDVALGTERUM i 850 mm - Opsætning af analyseflade afstand til vægge + justering af analysegrid / Overflade håndtering / Test af overflade normal (Overflade retning)
evalsrf_6 = EvaluateSurface(Surface=merge_3, Point=vec_5.Vector)  # -> Point, Normal, UDirection, VDirection, Frame; disabled
number_slider_8 = Slider(2000, range=0..10000)  # disabled
number_slider_9 = Slider(5, range=0..10)  # disabled
pcen_3 = PolygonCenter(Polyline=boundary_6)  # -> CenterV, CenterE, CenterA; disabled
multiplication_3 = Multiplication(A=evalsrf_6.Normal, B=number_slider_8)  # disabled
vdisex_3 = VectorDisplayEx(Point=pcen_3.CenterE, Vector=multiplication_3, Colour=RGB(0, 0, 0), Width=number_slider_9)  # disabled

# ---- group: UDVALGTERUM i 850 mm - Opsætning af analyseflade afstand til vægge + justering af analysegrid / Forskydning af analysefalde
arbejdsrum_undervisningsrum_opholdsrum_i = Panel("850")  # "arbejdsrum, undervisningsrum, opholdsrum i institutioner og rum med lignende funktioner"; disabled
lng_2 = ListLength(List=selected_rooms_2)
larger_2 = LargerThan(FirstNumber=lng_2, SecondNumber="0")  # -> LargerThan, OrEqualTo
Z_3 = UnitZ(Factor=arbejdsrum_undervisningsrum_opholdsrum_i)  # disabled
onoff_11 = EnableDisableObject(Enabled=larger_2.LargerThan, AllObjects_Object=move_3)
move_3 = Move(Geometry=merge_3, Motion=Z_3)  # -> Geometry, Transform; disabled

# ---- group: Detaljeret rum analyse
indtast_rumnavn_i_100_mm_analysehøjde = Panel("")  # disabled

# ---- group: Detaljeret rum analyse / Rum gruppering 3 - Analysehøjde 100 mm
rum_m_100_mm_analysehøjde = Panel(indtast_rumnavn_i_100_mm_analysehøjde)  # disabled
rooms_7 = QueryRooms(Placed=True, Name=rum_m_100_mm_analysehøjde, Enclosed=True)  # disabled
debrep_30 = DeconstructBrep(Brep=rooms_7)  # -> Faces, Edges, Vertices; disabled
panel_14 = Panel(rooms_7)  # disabled
udvælgelse_af_nederste_face_5 = UdvælgelseAfNedersteFace(S=debrep_30.Faces)  # disabled
item_24 = ListItem(List=debrep_30.Faces, Index=udvælgelse_af_nederste_face_5, Wrap=True)  # disabled

# ---- group: Detaljeret rum analyse / Samlet og frasorterede rum (continued)
mindex_11 = MemberIndex(Set=rooms_4, Member=flatten([rooms_5, rooms_6, rooms_7]))  # -> flatten(Index), Count; disabled
resterende_rum = CullIndex(List=rooms_4, Indices=mindex_11.Index, Wrap=True)  # disabled
liste_med_overskydende_rum_gruppering_1 = Panel(resterende_rum)  # "Liste med overskydende rum (gruppering 1, 2 og 3 er her frasorteret)"; disabled

# ----
liste_af_rum_i_modellen_der_ikker_ar_udv = Panel(liste_med_overskydende_rum_gruppering_1)  # "Liste af rum i modellen der ikker ar udvalgt"; disabled

# ---- group: UDVALGTERUM i 100 mm - Opsætning af analyseflade afstand til vægge + justering af analysegrid / DANNELSE AF ANALYSEFLADER
selected_rooms_3 = Geometry(item_24)  # disabled
debrep_31 = DeconstructBrep(Brep=selected_rooms_3)  # -> Faces, Edges, Vertices; disabled
line_4 = Line(debrep_31.Edges)
boundary_7 = BoundarySurfaces(Edges=line_4)
medges_4 = MeshEdges(Mesh=boundary_7)  # -> NakedEdges, InteriorEdges, NonManifoldEdges; disabled
join_4 = JoinCurves(Curves=medges_4.NakedEdges, Preserve=False)  # disabled

# ---- group: Detaljeret rum analyse (continued)
rum_der_er_udvalgt_til_analysen_analyse_3 = Panel(rooms_7)  # "Rum der er udvalgt til analysen - Analyse flade over gulv 100 mm"; disabled

# ---- group: UDVALGTERUM i 100 mm - Opsætning af analyseflade afstand til vægge + justering af analysegrid
number_slider_10 = Slider(300, range=0..1000)  # disabled
polyoffset_4 = PolylineOffset(
    Polylines=join_4,
    Distance=number_slider_10,
    Plane=Plane(origin=(0, 0, 0), x=(0, 0, 0), y=(0, 0, 0)),
    Tolerance=0.1595272236,
    ClosedFillet=1,
    OpenFillet=1,
    Miter=2)  # -> Contour, Holes; disabled
toggle_12 = BooleanToggle(True)  # disabled
clean_7 = CleanTree(RemoveNulls=True, RemoveInvalid=True, RemoveEmpty=toggle_12, Tree=polyoffset_4.Holes)  # disabled
boundary_8 = BoundarySurfaces(Edges=clean_7)  # disabled

# ---- group: UDVALGTERUM i 100 mm - Opsætning af analyseflade afstand til vægge + justering af analysegrid / Overflade håndtering / Flip af mulige forkertvendte overflader
vec_7 = VectorXYZ(XComponent=0, YComponent=0, ZComponent=0)  # -> Vector, Length; disabled
evalsrf_7 = EvaluateSurface(Surface=boundary_8, Point=vec_7.Vector)  # -> Point, Normal, UDirection, VDirection, Frame; disabled
panel_15 = Panel("-1")  # disabled
vec_8 = VectorXYZ(XComponent=0, YComponent=0, ZComponent=panel_15)  # -> Vector, Length; disabled
mindex_12 = MemberIndex(Set=evalsrf_7.Normal, Member=vec_8.Vector)  # -> Index, Count; disabled
bool_7 = Boolean(invert(mindex_12.Count))  # disabled
bool_8 = Boolean(mindex_12.Count)  # disabled
cull_33 = CullPattern(List=boundary_8, CullPattern=bool_8)  # disabled
cull_34 = CullPattern(List=boundary_8, CullPattern=bool_7)  # disabled
flip_4 = Flip(Surface=cull_33)  # -> Surface, Result; disabled
srf_4 = Surface(cull_34)  # disabled
merge_4 = Merge(Data1=flip_4.Surface, Data2=srf_4)  # disabled

# ---- group: UDVALGTERUM i 100 mm - Opsætning af analyseflade afstand til vægge + justering af analysegrid / Overflade håndtering / Test af overflade normal (Overflade retning)
evalsrf_8 = EvaluateSurface(Surface=merge_4, Point=vec_7.Vector)  # -> Point, Normal, UDirection, VDirection, Frame; disabled
number_slider_11 = Slider(2000, range=0..10000)  # disabled
number_slider_12 = Slider(5, range=0..10)  # disabled
pcen_4 = PolygonCenter(Polyline=boundary_8)  # -> CenterV, CenterE, CenterA; disabled
multiplication_4 = Multiplication(A=evalsrf_8.Normal, B=number_slider_11)  # disabled
vdisex_4 = VectorDisplayEx(Point=pcen_4.CenterE, Vector=multiplication_4, Colour=RGB(0, 0, 0), Width=number_slider_12)  # disabled

# ---- group: UDVALGTERUM i 100 mm - Opsætning af analyseflade afstand til vægge + justering af analysegrid / Forskydning af analyseflade
fælles_adgangsveje_butiksarealer_lagerha = Panel("100")  # "fælles adgangsveje, butiksarealer, lagerhaller og lignende arealer der ikke er defineret i bygningsreglementet"; disabled
lng_3 = ListLength(List=selected_rooms_3)
larger_3 = LargerThan(FirstNumber=lng_3, SecondNumber="0")  # -> LargerThan, OrEqualTo
Z_4 = UnitZ(Factor=fælles_adgangsveje_butiksarealer_lagerha)  # disabled
onoff_12 = EnableDisableObject(Enabled=larger_3.LargerThan, AllObjects_Object=move_4)
move_4 = Move(Geometry=merge_4, Motion=Z_4)  # -> Geometry, Transform; disabled

# ---- group: DANNELSE AF ANALYSEPUNKTER
geo_2 = Geometry(flatten([move_2.Geometry, move_3.Geometry, move_4.Geometry, move.Geometry]))
genpts = LBGeneratePointGrid(geometry=geo_2, grid_size=list_2, quad_only=Toggle(True))  # -> points, vectors, face_areas, graft(mesh); plug-in component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
sensorgrid = HBSensorGrid(positions=genpts.points, directions=genpts.vectors, mesh=genpts.mesh)  # -> grid; plug-in component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
medges_5 = MeshEdges(Mesh=genpts.mesh)  # -> NakedEdges, InteriorEdges, NonManifoldEdges

# ---- group: NORDPIL
# NORDPIL: Denne samling af komponenter definerer ikke noget i selve analysen, men bruges til at lave en visuel visning af nordpilen. det er også i disse komponenter nordpilen kan justeres, hvis der skulle være behov.
number_slider_13 = Slider(1930, range=0..10000)
samlet_gulvoverflade = Geometry(geo_2)
vec_9 = VectorXYZ(XComponent=0, YComponent=number_slider_13, ZComponent=0)  # -> Vector, Length
area_8 = Area(Geometry=samlet_gulvoverflade)  # -> Area, Centroid
multiplication_5 = Multiplication(A=vec_9.Vector, B=længde_på_pilen)
item_25 = ListItem(List=flatten(area_8.Centroid), Index=0, Wrap=True)
circle = CircleCNR(Center=area_8.Centroid, Normal=Vector(0, 0, 1), Radius=multiplication_5)
division = Division(A=multiplication_5, B=størrelse_på_nord_tekst)
item_26 = ListItem(List=flatten(circle), Index=0, Wrap=True)
eval = EvaluateLength(Curve=item_26, Length=Slider(0.25, range=0..1), Normalized=True)  # -> Point, Tangent, Parameter
rotation_degrees = Number(number_slider)
Y = UnitY(Factor=nord_tekst_afstand_til_pilens_spids)
move_5 = Move(Geometry=eval.Point, Motion=Y)  # -> Geometry, Transform
rad = Radians(Degrees=rotation_degrees)
xy = XYPlane(Origin=Point(0, 0, 0))
rot3d = Rotate3D(Geometry=move_5.Geometry, Angle=rad, Center=area_8.Centroid, Axis=xy)  # -> flatten(Geometry), Transform
swatch = ColourSwatch(SwatchColor=RGB(0, 0, 0))
item_27 = ListItem(List=rot3d.Geometry, Index=0, Wrap=True)
vrot = Rotate(Vector=multiplication_5, Axis=xy, Angle=rad)
vdisex_5 = VectorDisplayEx(Point=item_25, Vector=vrot, Colour=swatch, Width=tykkelse_på_pilen)
tag = TextTag3D(Location=item_27, Text=teksten_over_pilen, Size=division, Colour=swatch, Justification=8)

# ---- group: SAMMENSÆTNING AF 'HB MODEL' OG ANALYSEGRID
assigngridsviews = HBAssignGridsAndViews(model=model.model, grids=flatten(sensorgrid))  # -> model; plug-in component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

# ---- group: Visning af analyseområde
tænd_sluk_5 = BooleanToggle(False)
analysegrid = Geometry([medges_5.NakedEdges, medges_5.InteriorEdges])
vis_analysegrid = HideShowObjectPreview(Visible=tænd_sluk_5, AllObjects_Object=analysegrid)
tænd_sluk_6 = BooleanToggle(False)
vis_analyseflader = HideShowObjectPreview(Visible=tænd_sluk_6, AllObjects_Object=geo_2)

# ---- group: TIMEBASERET ÅRLIG DAGSLYSBEREGNING
boolean_toggle_true_false = Text(start_dagslyssimulering)
rotation_degrees_2 = Number(number_slider)
antal_soltimer = FilePath(sti_til_antal_soltimer_jvf_br18_standard)
analysis_model = Data(assigngridsviews)
annualdaylight = HBAnnualDaylight(
    model=analysis_model,
    wea=wea,
    north=rotation_degrees_2,
    schedule=antal_soltimer,
    radiance_par=radpar,
    run_settings=recipesettings,
    run=boolean_toggle_true_false)  # -> report, results, DA, cDA, UDI, UDI_low, UDI_up; plug-in component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

# ---- group: BEREGNING AF SPATIAL DAYLIGHT AUTONOMY (sDA)
# DAGSLYS SIMULERING
# Spatial Daylight Autonomy (sDA): 'HB Annual daylight metrics' bruges til at filtre dagslysresultatet fra 'HB Annual Daylight'-komponentet.
# 
# Her testes der efter hvilke af analysepuntkerne der bliver udsat for over til 300 lux (standard _threshold_ i komponentet). Dette betyder også at hvis den  der ønskes en anden øvre grænse, skal '_treshold_' ændres!
# 
# Resultat man får ud af komponentet er en procentsats af af analysetimerne der er over '_treshold_' mængde lus.
daylightmetrics = HBAnnualDaylightMetrics(results=[annualdaylight.results, daylight_lookup], threshold=list_5)  # -> report, DA, cDA, UDI, UDI_low, UDI_up; plug-in component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
sda = HBSpatialDaylightAutonomy(DA=daylightmetrics.DA)  # -> report, sDA, pass_fail; plug-in component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

# ---- group: EFTERVISNING AF RESULTAT / VISUEL VISNING AF DAGSLYSRESULTATET
analysis_surface_genpts_mesh = Mesh(genpts.mesh)
project_name = Text(definer_projektets_navn)
mjoin = MeshJoin(Meshes=flatten(analysis_surface_genpts_mesh))
concat = Concatenate(FragmentA=project_name, FragmentB="Dagslys Autonomi")
flatten = FlattenTree(Tree=daylightmetrics.DA, Path="{0}")
heatmap = LBSpatialHeatmap(values=flatten, mesh=mjoin, legend_par=legendpar, legend_title=concat, global_title="DA [%]")  # -> mesh, legend, title, colors, legend_par, vis_set; plug-in component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
analyse_resultat = Geometry(heatmap.mesh)
legend = Geometry(heatmap.legend)

# ---- group: Overfør mesh til revit
# REVIT GEOMETRI
round_to_nearest = Slider(5, range=0..10)
category_types = CategoryTypes({"Model": 1, "Annotation": 2, "Internal": 4, "Analytical": 5}, selected="Model")
mesh = Mesh(analysis_surface_genpts_mesh)
data_2 = Data(flatten)
categories_11 = QueryCategories(
    Type=category_types,
    IsVisibleUI=True,
    IsSubcategory=False,
    AllowsParameters=True,
    HasMaterialQuantities=True,
    Cuttable=True)
explode = MeshExplode(Mesh=mesh, Interpolate=False)
division_2 = Division(A=data_2, B=round_to_nearest)
round = Round(Number=division_2)  # -> Nearest, Floor, Ceiling
multiplication_6 = Multiplication(A=round.Nearest, B=round_to_nearest)
value_picker_5 = ValuePicker(categories_11, SearchPattern="generic")
cset = CreateSet(List=multiplication_6)  # -> Set, Map
gradient = Gradient(
    LowerLimit="100",
    UpperLimit="50",
    Parameter=cset.Set,
    stops=[0: RGB(234, 38, 0), 0.26: RGB(234, 126, 0), 0.5: RGB(254, 244, 84), 0.75: RGB(111, 143, 199), 1: RGB(57, 82, 122)])
assign_paths = AssignPaths(InputData=flatten(explode), PathsToAssign=flatten(cset.Map))
material = ConvertMaterial(Shader=gradient, TrackingMode=2)  # -> graft(Material)
category = Category(value_picker_5)
g_shape = AddDirectShapeGeometry(Name="Sollys", Category=category, Geometry=assign_paths, Material=material, TrackingMode=2)

# ---- group: EFTERVISNING AF RESULTAT / TEKST: SAMLET PROCENT AF ANALYSEOVERFLADEN HVOR DER OPNÅES 300 LUX (ELLER '_treshold_' fra 'HB Annual Daylight Metrics'-komponentet
python = GhPythonScript(x=sda.sDA)  # -> a
# ---------- python: Python ----------
a = "{:.2f}".format(x * 100)
# ---------- end python ----------
concat_2 = Concatenate(FragmentA="sDA: ", FragmentB=python, FragmentC="%")
area_9 = Area(Geometry=flatten(analysis_surface_genpts_mesh))  # -> Area, Centroid
tag_2 = TextTag3D(
    Location=area_9.Centroid,
    Text=concat_2,
    Size=Slider(300, range=0..1000),
    Colour=ColourSwatch(SwatchColor=RGB(0, 0, 0)),
    Justification=5)

# ---- group: Analyse af datapunkter
# ANALYSE AF RESULTAT
daylight_autonomy_results = Data(daylightmetrics.DA)

# ---- group: Analyse af datapunkter / Samlet sDA resultat for hele analyseområdet
flatten_2 = FlattenTree(Tree=daylight_autonomy_results, Path="{0}")
lng_4 = ListLength(List=flatten_2)
panel_16 = Panel("0.2")
sort_7 = SortList(Keys=flatten_2)  # -> Keys, ValuesA
multiplication_7 = Multiplication(A=lng_4, B=panel_16)
split = SplitList(List=sort_7.Keys, Index=multiplication_7)  # -> ListA, ListB
avr = Average(Input=flatten(daylight_autonomy_results))
avr_2 = Average(Input=split.ListB)
gennemsnitlig_sda_for_hele_analyseområde = Panel(avr)  # "Gennemsnitlig sDA for hele analyseområdet"
gennemsnit_af_de_80_højeste_datapunkter = Panel(avr_2)
lng_5 = ListLength(List=split.ListB)
expression = Expression(x="sDA:", y=gennemsnit_af_de_80_højeste_datapunkter, Expression="Format(\"{0} {1}%\", x, y)")
expression_2 = Expression(x="Antal analysepunkter (80% højeste):", y=lng_5, Expression="Format(\"{0} {1}\", x, y)")  # -> flatten(R)
expression_3 = Expression(x="Samlet anatal analysepunkter:", y=lng_4, Expression="Format(\"{0} {1}\", x, y)")
merge_5 = Merge(Data1=flatten(expression), Data2=expression_2, Data3=expression_3)
panel_17 = Panel(merge_5)

# ----
room_2 = Room([rooms_5, rooms_6, rooms_7, room])

# ---- group: Analyseresultat
# Oversigt over analyserede rum og deres resultat.
gennemsnit_af_de_80_højeste_datapunkter_2 = Panel(merge_5)  # "Gennemsnit af de 80% højeste datapunkter (DGNB)"

# ---- group: Tilføjelse af analyse resultat tekst til specifikt Revit sheet
tilføj_sda_tekst_på_plan_i_revit = Button()
# Visuel
tilføj_sda_tekst_i_plan = EnableDisableObject(Enabled=tilføj_sda_tekst_på_plan_i_revit, AllObjects_Object=text)

# ---- group: Analyse af datapunkter / Tekst til revit plan
views = QueryViews(IsDependent=False, IsTemplate=False)
center_point = Point(area_9.Centroid)
sda_tekst = Text(concat_2)
views_by_family = ClusterViewsFamily(Views=views)  # -> _3DViews, AreaPlan, CeilingPlan, Detail, Elevation, FloorPlan, Section, Sheets

# ---- group: Tilføjelse af analyse resultat tekst til specifikt Revit sheet (continued)
tilføjes_på_plan = ValuePicker(views_by_family.FloorPlan)

# ---- group: Analyse af datapunkter / Tekst til revit plan (continued)
selected_view = Data(tilføjes_på_plan)
text = AddText(View=selected_view, CenterPunkt=center_point, Content=sda_tekst, TrackingMode=2)  # disabled

# ---- group: Analyse af datapunkter / Analyserede datapunkter for analyseområdet
lng_6 = ListLength(List=daylight_autonomy_results)
unflatten = UnflattenTree(Tree=room_2, Guide=lng_6)
flatten_3 = FlattenTree(Tree=python, Path="{0}")  # -> graft(Tree)
expression_4 = Expression(x="Antal analysepunkter:", y=lng_6, Expression="Format(\"{0} {1}\", x, y)")
expression_5 = Expression(x="sDA:", y=flatten_3, Expression="Format(\"{0} {1}%\", x, y)")
merge_6 = Merge(Data1=unflatten, Data2=expression_4, Data3=expression_5)
flatten_4 = FlattenTree(Tree=daylight_autonomy_results, Path="{0}")
lng_7 = ListLength(List=flatten_4)
samlet_analyserede_datapunkter = Panel(lng_7)
analyserede_datapunkter_for_alle_analyse = Panel(merge_6)  # "Analyserede datapunkter for alle analyserede rum"

# ---- group: Analyseresultat (continued)
# Analyse af resultatbehandling af dagslysresultat
list_14 = ItemSelector(unflatten, {"Revit Room : Kitchen & Dining 101 : id 857279"}, selected="Revit Room : Kitchen & Dining 101 : id 857279")
# ANALYSE
mindex_13 = MemberIndex(Set=merge_6, Member=list_14)  # -> Index, Count
cull_35 = CullPattern(List=merge_6, CullPattern=mindex_13.Count)  # -> flatten(List)
analyserede_datapunkter_for_udvalgt_rum = Panel(cull_35)

# ---- group: Analyse af datapunkter / Analyserede datapunkter for analyseområdet (continued)
mindex_14 = MemberIndex(Set=merge_6, Member=list_14)  # -> Index, Count
cull_36 = CullPattern(List=merge_6, CullPattern=mindex_14.Count)  # -> flatten(List)
analyserede_datapunkter_for_udvalgt_rum_2 = Panel(cull_36)

# ==== cluster Cluster
E = ClusterInput()
døre = EnableDisableObject(Enabled=E)
T = ClusterInput()
python = GhPythonScript(x="Døre er indlæst i modellen", y="Døre er IKKE indlæst i modellen", T=T)  # -> out, a
# ---------- python: Python ----------
__author__ = "lhf"
__version__ = "2024.01.26"

if T>0:
    a=x
else:
    a=y
# ---------- end python ----------
a = ClusterOutput(python.a)

# ==== cluster Cluster_2
E = ClusterInput()
døre_glas = EnableDisableObject(Enabled=E)
T = ClusterInput()
python = GhPythonScript(x="Døre m. glas er indlæst i modellen", y="Døre m. glas er IKKE indlæst i modellen", T=T)  # -> out, a; same code as python
a = ClusterOutput(python.a)

# ==== cluster Cluster_3
E = ClusterInput()
kontekst = EnableDisableObject(Enabled=E)
T = ClusterInput()
python = GhPythonScript(x="Kontekst bygninger er indlæst i modellen", y="Kontekst bygning er IKKE indlæst i modellen", T=T)  # -> out, a; same code as python
a = ClusterOutput(python.a)

# ==== cluster Cluster_4
E = ClusterInput()
terrain = EnableDisableObject(Enabled=E)
T = ClusterInput()
python = GhPythonScript(x="Rhino terræn er indlæst i modellen", y="Rhino terræn er IKKE indlæst i modellen", T=T)  # -> out, a; same code as python
a = ClusterOutput(python.a)

# ==== cluster Cluster_5
E = ClusterInput()
V = ClusterInput()
terrain = EnableDisableObject(Enabled=E)
hideshow = HideShowObjectPreview(Visible=V)
T = ClusterInput()
python = GhPythonScript(x="Revit terræn er indlæst i modellen", y="Revit terræn er IKKE indlæst i modellen", T=T)  # -> out, a; same code as python
a = ClusterOutput(python.a)

# ==== cluster UdvælgelseAfNedersteFace
Y = UnitY(Factor=1)
X = UnitX(Factor=1)
Z = UnitZ(Factor=1)
list = ValueList({"North": 0, "South": 1, "East": 2, "West": 3, "Top": 4, "Bottom": 5}, selected="Bottom")
S = ClusterInput()
rev = Reverse(Vector=Y)
rev_2 = Reverse(Vector=Z)
rev_3 = Reverse(Vector=X)
evalsrf = EvaluateSurface(Surface=reparameterize(S), Point="0.5,0.5")  # -> Point, Normal, UDirection, VDirection, Frame
filter = StreamFilter(Gate=list, Stream0=Y, Stream1=rev, Stream2=X, Stream3=rev_3, Stream4=Z, Stream5=rev_2)
mindex = MemberIndex(Set=evalsrf.Normal, Member=filter)  # -> Index, Count
I = ClusterOutput(mindex.Index)
